# Grasshopper definition 001_Angle_sum_diff_identities.gh (Grasshopper 1.0.7)
# plug-ins: RhinoCodePluginGH

# WICKERSON STUDIOS
# gpt-4 to C#
# BOILER PLATE
# Grasshopper Files
# gpt-4 Text Prompt
# gpt-4 Initial Response
image_sampler = ImageSampler(
    FilePath="C:\Users\Sculpture\Desktop\gpt_4_image_script\MathType_001.JPG",
    Filter="Value",
    Interpolate=True,
    Umax=1,
    Umin=0,
    Vmax=1,
    Vmin=0,
    Wrap=1)

# ----
# Let's convert the angle sum and difference
# identities from the provided image into a
# graphical representation using C# in a
# Grasshopper script for Rhino8.
# 
# For the sake of simplicity, I will create a 2D
# visual representation of these formulas. The
# sine, cosine, and tangent functions will be
# depicted as parametric curves on a 2D plane,
# with the x-axis representing the angle and the
# y-axis representing the function's value.
# Use this script editor template to create a script
#  for the C# node in grasshopper for rhino8 that
# models geometry for
# 
# this image
# 
# and specifically to
# 
# turn the formula into an interesting geometry
# 
# //Grasshopper Script Instance
# //#! csharp
# using System;
# using System.Collections;
# using System.Collections.Generic;
# using System.Drawing;
# 
# using Rhino;
# using Rhino.Geometry;
# 
# using Grasshopper;
# using Grasshopper.Kernel;
# using Grasshopper.Kernel.Data;
# using Grasshopper.Kernel.Types;
# 
# public class Script_Instance : GH_ScriptInstance
# {
#   /*
#     Members:
#       RhinoDoc RhinoDocument
#       GH_Document GrasshopperDocument
#       IGH_Component Component
#       int Iteration
# 
#     Methods (Virtual & overridable):
#       Print(string text)
#       Print(string format, params object[] args)
#       Reflect(object obj)
#       Reflect(object obj, string method_name)
#   */
# 
#   private void RunScript(object x, object y, out object a)
#   {
#     // Write your logic here
#     a = null;
#   }
# }
# BASIC SCRIPT
number_slider = Slider(10, range=0..10)
# gpt-4 Transcript link:
# 
# Sharing conversations with images is not yet supported
number_slider_2 = Slider(0.41, range=0.1..1)
mathtype_001 = Script(maxAngle=number_slider, increment=number_slider_2)  # -> out, sinPoints, cosPoints, tanPoints; inputs maxAngle: Double, increment: Double
# ---------- mathtype_001: C# ----------
// Grasshopper Script Instance
using System;
using System.Collections;
using System.Collections.Generic;
using System.Drawing;

using Rhino;
using Rhino.Geometry;

using Grasshopper;
using Grasshopper.Kernel;
using Grasshopper.Kernel.Data;
using Grasshopper.Kernel.Types;

using System;
using System.Collections.Generic;
using Rhino.Geometry;

public class Script_Instance : GH_ScriptInstance
{
  // Override the RunScript method
  private void RunScript(double maxAngle, double increment, out List<Point3d> sinPoints, out List<Point3d> cosPoints, out List<Point3d> tanPoints)
  {
    sinPoints = new List<Point3d>();
    cosPoints = new List<Point3d>();
    tanPoints = new List<Point3d>();

    for(double a = 0; a <= maxAngle; a += increment)
    {
      for(double b = 0; b <= maxAngle; b += increment)
      {
        double sinVal = Math.Sin(a + b);
        double cosVal = Math.Cos(a + b);
        double tanVal;
        try
        {
          tanVal = Math.Tan(a + b);
        }
        catch
        {
          tanVal = double.MaxValue;  // Avoiding division by zero
        }

        sinPoints.Add(new Point3d(a, b, sinVal));
        cosPoints.Add(new Point3d(a, b, cosVal));
        if(Math.Abs(tanVal) < 10)  // To limit the tan values which can become very large
        {
          tanPoints.Add(new Point3d(a, b, tanVal));
        }
      }
    }
  }
}
# ---------- end mathtype_001 ----------
geometry = Geometry(mathtype_001.sinPoints)
geometry_2 = Geometry(mathtype_001.cosPoints)
geometry_3 = Geometry(mathtype_001.tanPoints)
panel = Panel(mathtype_001.out)
entwine = Entwine(Branch00=geometry, Branch01=geometry_2, Branch02=geometry_3, FlattenInputs=True)
panel_2 = Panel(entwine)
