# Grasshopper definition 002_Lagrange_Burmann_Theorem.gh (Grasshopper 1.0.7)
# plug-ins: RhinoCodePluginGH

# WICKERSON STUDIOS
# gpt-4 to C#
# BOILER PLATE
# Grasshopper Files
# gpt-4 Text Prompt
image_sampler = ImageSampler(
    FilePath="C:\Users\Sculpture\Desktop\gpt_4_image_script\MathType_002.JPG",
    Filter="Value",
    Interpolate=True,
    Umax=1,
    Umin=0,
    Vmax=1,
    Vmin=0,
    Wrap=1)

# ----
# BASIC SCRIPT
# gpt-4 Transcript link:
# 
# Sharing conversations with images is not yet supported
number_slider = Slider(5.91, range=0..10)
# gpt-4 Initial Response
# To create a script that models the given formula
# into an interesting geometry, we can consider
# using the formula to generate points or curves in
#  a 3D space. The Lagrange-Bürmann Theorem
# uses an infinite series. However, for visualization
#  purposes, we might consider visualizing the first
# few terms.
# Use this script editor template to create a script
#  for the C# node in grasshopper for rhino8 that
# models geometry for
# 
# this image
# 
# and specifically to
# 
# turn the formula into an interesting geometry
# 
# //Grasshopper Script Instance
# //#! csharp
# using System;
# using System.Collections;
# using System.Collections.Generic;
# using System.Drawing;
# 
# using Rhino;
# using Rhino.Geometry;
# 
# using Grasshopper;
# using Grasshopper.Kernel;
# using Grasshopper.Kernel.Data;
# using Grasshopper.Kernel.Types;
# 
# public class Script_Instance : GH_ScriptInstance
# {
#   /*
#     Members:
#       RhinoDoc RhinoDocument
#       GH_Document GrasshopperDocument
#       IGH_Component Component
#       int Iteration
# 
#     Methods (Virtual & overridable):
#       Print(string text)
#       Print(string format, params object[] args)
#       Reflect(object obj)
#       Reflect(object obj, string method_name)
#   */
# 
#   private void RunScript(object x, object y, out object a)
#   {
#     // Write your logic here
#     a = null;
#   }
# }
number_slider_2 = Slider(1.11, range=0..10)
mathtype_002 = Script(z=number_slider_2, a=number_slider)  # -> out, curve; inputs z: Double, a: Double
# ---------- mathtype_002: C# ----------
// Grasshopper Script Instance
using System;
using System.Collections;
using System.Collections.Generic;
using System.Drawing;

using Rhino;
using Rhino.Geometry;

using Grasshopper;
using Grasshopper.Kernel;
using Grasshopper.Kernel.Data;
using Grasshopper.Kernel.Types;

using System;
using System.Collections;
using System.Collections.Generic;
using System.Drawing;

using Rhino;
using Rhino.Geometry;

using Grasshopper;
using Grasshopper.Kernel;
using Grasshopper.Kernel.Data;
using Grasshopper.Kernel.Types;

public class Script_Instance : GH_ScriptInstance
{
    /* 
      Members:
        RhinoDoc RhinoDocument
        GH_Document GrasshopperDocument
        IGH_Component Component
        int Iteration

      Methods (Virtual & overridable):
        Print(string text)
        Print(string format, params object[] args)
        Reflect(object obj)
        Reflect(object obj, string method_name)
    */
    
    private void RunScript(double z, double a, out object curve)
    {
        List<Point3d> points = new List<Point3d>();

        double radius = 1; 
        double heightInterval = 0.5; 

        // Simulating the infinite series up to a certain number
        for (int n = 1; n <= 10; n++)
        {
            double angle = 2 * Math.PI * n;
            double height = n * heightInterval;

            // Using the formula to generate the x and y coordinates of points in a spiral
            double x = radius * Math.Cos(angle);
            double y = radius * Math.Sin(angle);
            
            // The coefficient gn is represented here as height variation
            double gn = (Math.Pow(z - a, n)) / (Math.Pow(10, n)); 
            height += gn;

            points.Add(new Point3d(x, y, height));
            radius += 0.5;
        }

        curve = new PolylineCurve(points);
    }
}
# ---------- end mathtype_002 ----------
geometry = Geometry(mathtype_002.curve)
panel = Panel(mathtype_002.out)
panel_2 = Panel(geometry)
entwine = Entwine(Branch00=geometry, FlattenInputs=True)
