# Grasshopper definition 003_Bell_Numbers.gh (Grasshopper 1.0.7)
# plug-ins: RhinoCodePluginGH

# WICKERSON STUDIOS
# gpt-4 to C#
# BOILER PLATE
# Grasshopper Files
# gpt-4 Text Prompt
# gpt-4 Initial Response
# Use this script editor template to create a script
#  for the C# node in grasshopper for rhino8 that
# models geometry for
# 
# this image
# 
# and specifically to
# 
# turn the formula into an interesting geometry
# 
# //Grasshopper Script Instance
# //#! csharp
# using System;
# using System.Collections;
# using System.Collections.Generic;
# using System.Drawing;
# 
# using Rhino;
# using Rhino.Geometry;
# 
# using Grasshopper;
# using Grasshopper.Kernel;
# using Grasshopper.Kernel.Data;
# using Grasshopper.Kernel.Types;
# 
# public class Script_Instance : GH_ScriptInstance
# {
#   /*
#     Members:
#       RhinoDoc RhinoDocument
#       GH_Document GrasshopperDocument
#       IGH_Component Component
#       int Iteration
# 
#     Methods (Virtual & overridable):
#       Print(string text)
#       Print(string format, params object[] args)
#       Reflect(object obj)
#       Reflect(object obj, string method_name)
#   */
# 
#   private void RunScript(object x, object y, out object a)
#   {
#     // Write your logic here
#     a = null;
#   }
# }
image_sampler = ImageSampler(
    FilePath="C:\Users\Sculpture\Desktop\gpt_4_image_script\MathType_003.JPG",
    Filter="Value",
    Interpolate=True,
    Umax=1,
    Umin=0,
    Vmax=1,
    Vmin=0,
    Wrap=1)
# Given the request, I'll provide a simple geometry
# representation of the Bell Numbers formula.
# Let's use circles to represent each term of the
# formula. The radius of each circle will be
# determined by the term's value. Here's how you
# can represent the Bell Numbers in Grasshopper
# using C#:
# ADVANCED  SCRIPT
# gpt-4 Transcript link:
# 
# Sharing conversations with images is not yet supported
number_slider = Slider(3, range=0..10)
mathtyp_003 = Script(n=number_slider)  # -> out, branches; inputs n: Int32
# ---------- mathtyp_003: C# ----------
// Grasshopper Script Instance
using System;
using System.Collections;
using System.Collections.Generic;
using System.Drawing;

using Rhino;
using Rhino.Geometry;

using Grasshopper;
using Grasshopper.Kernel;
using Grasshopper.Kernel.Data;
using Grasshopper.Kernel.Types;

using System;
using System.Collections.Generic;
using Rhino.Geometry;

public class Script_Instance : GH_ScriptInstance
{
  /* 
    Members:
      RhinoDoc RhinoDocument
      GH_Document GrasshopperDocument
      IGH_Component Component
      int Iteration

    Methods (Virtual & overridable):
      Print(string text)
      Print(string format, params object[] args)
      Reflect(object obj)
      Reflect(object obj, string method_name)
  */

  private void RunScript(int n, out object branches)
  {
    branches = new List<Line>();
    Point3d origin = new Point3d(0, 0, 0);
    double initialLength = 10;

    GenerateBranches(origin, Vector3d.ZAxis, initialLength, n, branches);
  }

  private void GenerateBranches(Point3d start, Vector3d direction, double length, int depth, List<Line> branches)
  {
    if (depth <= 0) return;

    Point3d end = start + direction * length;
    branches.Add(new Line(start, end));

    int k = depth; 
    double bellComponent = Math.Pow(k, k) / Factorial(k);

    // Create three child branches to fan out in 3D
    Vector3d leftBranchDirection = RotateVector(direction, bellComponent * Math.PI / 2, Vector3d.ZAxis);
    Vector3d rightBranchDirection = RotateVector(direction, -bellComponent * Math.PI / 2, Vector3d.ZAxis);
    Vector3d upBranchDirection = RotateVector(direction, bellComponent * Math.PI / 4, Vector3d.XAxis);

    GenerateBranches(end, leftBranchDirection, length * 0.7, depth - 1, branches);
    GenerateBranches(end, rightBranchDirection, length * 0.7, depth - 1, branches);
    GenerateBranches(end, upBranchDirection, length * 0.7, depth - 1, branches);
  }

  private Vector3d RotateVector(Vector3d vector, double angle, Vector3d axis)
  {
    Transform rotation = Transform.Rotation(angle, axis, new Point3d(0, 0, 0));
    vector.Transform(rotation);
    return vector;
  }

  private double Factorial(int n)
  {
    double result = 1;
    for (int i = 1; i <= n; i++)
      result *= i;
    return result;
  }
}
# ---------- end mathtyp_003 ----------
geometry = Geometry(mathtyp_003.branches)
entwine = Entwine(Branch00=geometry, FlattenInputs=True)
panel = Panel(mathtyp_003.out)
panel_2 = Panel(geometry)
