# Grasshopper definition 004_Pearson_Correlation_Coef.gh (Grasshopper 1.0.7)
# plug-ins: RhinoCodePluginGH

# WICKERSON STUDIOS
# gpt-4 to C#
# BOILER PLATE
# Grasshopper Files
# gpt-4 Text Prompt
# gpt-4 Initial Response
# Certainly! Let's attempt to create a simple C#
# script in Grasshopper for Rhino 8 that
# represents the Pearson Correlation Coefficient
# formula as an abstract geometry. For the sake
# of simplicity, let's represent:
# 
# The numerator as a polyline that oscillates
# based on the products of (X_i - X)(Y_i - Y).
# The denominator as two circles whose radii are
# determined by the sums (X_i - X)^2 and (Y_i -
# Y)^2, respectively.
# Use this script editor template to create a script
#  for the C# node in grasshopper for rhino8 that
# models geometry for
# 
# this image
# 
# and specifically to
# 
# turn the formula into an interesting geometry
# 
# //Grasshopper Script Instance
# //#! csharp
# using System;
# using System.Collections;
# using System.Collections.Generic;
# using System.Drawing;
# 
# using Rhino;
# using Rhino.Geometry;
# 
# using Grasshopper;
# using Grasshopper.Kernel;
# using Grasshopper.Kernel.Data;
# using Grasshopper.Kernel.Types;
# 
# public class Script_Instance : GH_ScriptInstance
# {
#   /*
#     Members:
#       RhinoDoc RhinoDocument
#       GH_Document GrasshopperDocument
#       IGH_Component Component
#       int Iteration
# 
#     Methods (Virtual & overridable):
#       Print(string text)
#       Print(string format, params object[] args)
#       Reflect(object obj)
#       Reflect(object obj, string method_name)
#   */
# 
#   private void RunScript(object x, object y, out object a)
#   {
#     // Write your logic here
#     a = null;
#   }
# }
image_sampler = ImageSampler(
    FilePath="C:\Users\Sculpture\Desktop\gpt_4_image_script\MathType_004.JPG",
    Filter="Value",
    Interpolate=True,
    Umax=1,
    Umin=0,
    Vmax=1,
    Vmin=0,
    Wrap=1)
# ADVANCED  SCRIPT
# gpt-4 Transcript link:
# 
# Sharing conversations with images is not yet supported
range = Range(Domain=Domain(0, 1), Steps=10)
mathtype_004 = Script(X=range, Y=range)  # -> out, Spiral, Surfaces, CircleCurves; inputs X: list of Double, Y: list of Double
# ---------- mathtype_004: C# ----------
// Grasshopper Script Instance
using System;
using System.Collections;
using System.Collections.Generic;
using System.Drawing;

using Rhino;
using Rhino.Geometry;

using Grasshopper;
using Grasshopper.Kernel;
using Grasshopper.Kernel.Data;
using Grasshopper.Kernel.Types;

using System;
using System.Collections.Generic;
using Rhino.Geometry;

public class Script_Instance : GH_ScriptInstance
{
    private void RunScript(IEnumerable<double> X, IEnumerable<double> Y, out object Spiral, out object Surfaces, out object CircleCurves)
    {
        double meanX = ComputeMean(X);
        double meanY = ComputeMean(Y);
        
        List<Point3d> spiralPoints = new List<Point3d>();
        List<Circle> circles = new List<Circle>();
        List<Curve> curves = new List<Curve>();
        
        double sumX = 0;
        double sumY = 0;
        double angleIncrement = Math.PI * 0.25;
        double currentAngle = 0;

        for (int i = 0; i < X.Count; i++)
        {
            double deltaX = X[i] - meanX;
            double deltaY = Y[i] - meanY;
            
            double distance = deltaX * deltaY;
            Point3d spiralPoint = new Point3d(distance * Math.Cos(currentAngle), distance * Math.Sin(currentAngle), i);
            spiralPoints.Add(spiralPoint);

            sumX += deltaX * deltaX;
            sumY += deltaY * deltaY;

            Circle circleX = new Circle(spiralPoint, Math.Sqrt(sumX));
            Circle circleY = new Circle(spiralPoint, Math.Sqrt(sumY));

            circles.Add(circleX);
            circles.Add(circleY);

            currentAngle += angleIncrement;
        }

        Spiral = new Polyline(spiralPoints);

        // Attempt to loft between circles
        Surfaces = new List<Brep>();
        for (int i = 0; i < circles.Count - 2; i+=2)
        {
            List<Curve> sectionCurves = new List<Curve> { circles[i].ToNurbsCurve(), circles[i + 2].ToNurbsCurve() };
            Brep[] loftedSurface = Brep.CreateFromLoft(sectionCurves, Point3d.Unset, Point3d.Unset, LoftType.Normal, false);
            if (loftedSurface != null && loftedSurface.Length > 0)
            {
                Surfaces.AddRange(loftedSurface);
            }

            sectionCurves = new List<Curve> { circles[i + 1].ToNurbsCurve(), circles[i + 3].ToNurbsCurve() };
            loftedSurface = Brep.CreateFromLoft(sectionCurves, Point3d.Unset, Point3d.Unset, LoftType.Normal, false);
            if (loftedSurface != null && loftedSurface.Length > 0)
            {
                Surfaces.AddRange(loftedSurface);
            }
        }

        CircleCurves = curves;
    }

    private double ComputeMean(List<double> list)
    {
        double sum = 0;
        foreach (double val in list)
            sum += val;
        return sum / list.Count;
    }
}
# ---------- end mathtype_004 ----------
geometry = Geometry(mathtype_004.Surfaces)
geometry_2 = Geometry(mathtype_004.CircleCurves)
geometry_3 = Geometry(mathtype_004.Spiral)
panel = Panel(mathtype_004.out)
entwine = Entwine(Branch00=geometry_3, Branch01=geometry, Branch02=geometry_2, FlattenInputs=True)
panel_2 = Panel(entwine)
# BASIC SCRIPT
range_2 = Range(Domain=Domain(0, 1), Steps=10)
mathtype_004_2 = Script(X=range_2, Y=range_2)  # -> out, Polyline, Circles; inputs X: list of Double, Y: list of Double
# ---------- mathtype_004_2: C# ----------
// Grasshopper Script Instance
using System;
using System.Collections;
using System.Collections.Generic;
using System.Drawing;

using Rhino;
using Rhino.Geometry;

using Grasshopper;
using Grasshopper.Kernel;
using Grasshopper.Kernel.Data;
using Grasshopper.Kernel.Types;

using System;
using System.Collections.Generic;
using Rhino.Geometry;

public class Script_Instance : GH_ScriptInstance
{
    private void RunScript(IEnumerable<double> X, IEnumerable<double> Y, out object Polyline, out object Circles)
    {
        double meanX = ComputeMean(X);
        double meanY = ComputeMean(Y);
        
        List<Point3d> points = new List<Point3d>();
        double sumX = 0;
        double sumY = 0;
        
        for (int i = 0; i < X.Count; i++)
        {
            double deltaX = X[i] - meanX;
            double deltaY = Y[i] - meanY;
            points.Add(new Point3d(i, deltaX * deltaY, 0));
            sumX += deltaX * deltaX;
            sumY += deltaY * deltaY;
        }

        Polyline = new Polyline(points);

        Circle circleX = new Circle(new Point3d(0, 0, 5), Math.Sqrt(sumX));
        Circle circleY = new Circle(new Point3d(0, 0, -5), Math.Sqrt(sumY));

        Circles = new List<Circle> { circleX, circleY };
    }

    private double ComputeMean(List<double> list)
    {
        double sum = 0;
        foreach (double val in list)
            sum += val;
        return sum / list.Count;
    }
}
# ---------- end mathtype_004_2 ----------
geometry_4 = Geometry(mathtype_004_2.Circles)
geometry_5 = Geometry(mathtype_004_2.Polyline)
panel_3 = Panel(mathtype_004_2.out)
entwine_2 = Entwine(Branch00=geometry_5, Branch01=geometry_4, FlattenInputs=True)
panel_4 = Panel(entwine_2)
