# Grasshopper definition 005_Third_Law_of_Kepler.gh (Grasshopper 1.0.7)
# plug-ins: RhinoCodePluginGH

# WICKERSON STUDIOS
# gpt-4 to C#
# BOILER PLATE
# Grasshopper Files
# gpt-4 Text Prompt
# gpt-4 Initial Response
# Alright, let's convert Kepler's Third Law into an
# interesting geometry!
# 
# One way to visualize Kepler's Third Law in
# geometry is by generating ellipses where the
# ratio of the square of the period of orbit (T^2) to
# the cube of the semi-major axis length (a^3) is
# consistent (as per the law). We can create a
# series of ellipses where each successive ellipse
# has a longer semi-major axis (a) and a
# correspondingly longer period (T), maintaining
# the relationship
#  .
# Use this script editor template to create a script
#  for the C# node in grasshopper for rhino8 that
# models geometry for
# 
# this image
# 
# and specifically to
# 
# turn the formula into an interesting geometry
# 
# //Grasshopper Script Instance
# //#! csharp
# using System;
# using System.Collections;
# using System.Collections.Generic;
# using System.Drawing;
# 
# using Rhino;
# using Rhino.Geometry;
# 
# using Grasshopper;
# using Grasshopper.Kernel;
# using Grasshopper.Kernel.Data;
# using Grasshopper.Kernel.Types;
# 
# public class Script_Instance : GH_ScriptInstance
# {
#   /*
#     Members:
#       RhinoDoc RhinoDocument
#       GH_Document GrasshopperDocument
#       IGH_Component Component
#       int Iteration
# 
#     Methods (Virtual & overridable):
#       Print(string text)
#       Print(string format, params object[] args)
#       Reflect(object obj)
#       Reflect(object obj, string method_name)
#   */
# 
#   private void RunScript(object x, object y, out object a)
#   {
#     // Write your logic here
#     a = null;
#   }
# }
image_sampler = ImageSampler(
    FilePath="C:\Users\Sculpture\Desktop\gpt_4_image_script\MathType_005.JPG",
    Filter="Value",
    Interpolate=True,
    Umax=1,
    Umin=0,
    Vmax=1,
    Vmin=0,
    Wrap=1)

# ----
# ADVANCED  SCRIPT
number_slider = Slider(10, range=0..10)
# gpt-4 Transcript link:
# 
# Sharing conversations with images is not yet supported
number_slider_2 = Slider(2.43, range=0..10)
mathtype_005 = Script(
    numEllipses=number_slider,
    baseAxis=Slider(1.98, range=0..100),
    scaleFactor=Slider(0.32, range=0..10),
    baseEccentricity=number_slider_2)  # -> out, ellipses, spirals; inputs numEllipses: Int32, baseAxis: Double, scaleFactor: Double, baseEccentricity: Double
# ---------- mathtype_005: C# ----------
// Grasshopper Script Instance
using System;
using System.Collections;
using System.Collections.Generic;
using System.Drawing;

using Rhino;
using Rhino.Geometry;

using Grasshopper;
using Grasshopper.Kernel;
using Grasshopper.Kernel.Data;
using Grasshopper.Kernel.Types;

using System;
using System.Collections.Generic;
using Rhino.Geometry;

public class Script_Instance : GH_ScriptInstance
{
    private void RunScript(int numEllipses, double baseAxis, double scaleFactor, double baseEccentricity, out object ellipses, out object spirals)
    {
        ellipses = new List<Curve>();
        spirals = new List<Curve>();

        for (int i = 1; i <= numEllipses; i++)
        {
            // Define the semi-major axis and the eccentricity
            double a = baseAxis * i * scaleFactor;
            double eccentricity = baseEccentricity + 0.05 * i; // Introducing variation in eccentricity
            if (eccentricity > 0.9) eccentricity = 0.9; // Clamping to ensure it's a valid ellipse

            // Calculate the semi-minor axis using the eccentricity
            double b = a * Math.Sqrt(1 - Math.Pow(eccentricity, 2));

            // Create the ellipse
            Ellipse ellipse = new Ellipse(Plane.WorldXY, a, b);
            ellipses.Add(ellipse.ToNurbsCurve());

            // Spiral to represent the time period
            double T = Math.Pow(a, 1.5) * scaleFactor; // Assuming GM/4π^2 = 1 for simplicity
            double spiralSpacing = a / 15.0; // Define spacing for the spiral loops
            for (double t = 0; t < T; t += 0.01)
            {
                double r = a + spiralSpacing * t;
                double theta = 2 * Math.PI * t;
                Point3d pt = new Point3d(r * Math.Cos(theta), r * Math.Sin(theta), 0);
                if (t == 0)
                    spirals.Add(new Line(Plane.WorldXY.Origin, pt).ToNurbsCurve());
                else
                {
                    Curve lastSpiral = spirals[spirals.Count - 1];
                    Curve extendedSpiral = Curve.CreateInterpolatedCurve(new List<Point3d> { lastSpiral.PointAtEnd, pt }, 1);
                    spirals[spirals.Count - 1] = extendedSpiral;
                }
            }
        }
    }
}
# ---------- end mathtype_005 ----------
geometry = Geometry(mathtype_005.ellipses)
geometry_2 = Geometry(mathtype_005.spirals)
panel = Panel(mathtype_005.out)
loft = Loft(Curves=geometry_2, Options={Adjust=False, Closed=False, LoftEnds=0, LoftSimp=0, LoftType=0, Rebuild=10, Refit=0.01})
entwine = Entwine(Branch00=geometry, Branch01=geometry_2, Branch02=loft, FlattenInputs=True)
panel_2 = Panel(entwine)

# ----
# BASIC SCRIPT
number_slider_3 = Slider(2, range=0..10)
mathtype_005_2 = Script(numEllipses=number_slider_3, baseAxis=Slider(15.09, range=0..100))  # -> out, ellipses; inputs numEllipses: Int32, baseAxis: Double
# ---------- mathtype_005_2: C# ----------
// Grasshopper Script Instance
using System;
using System.Collections;
using System.Collections.Generic;
using System.Drawing;

using Rhino;
using Rhino.Geometry;

using Grasshopper;
using Grasshopper.Kernel;
using Grasshopper.Kernel.Data;
using Grasshopper.Kernel.Types;

using System;
using System.Collections.Generic;
using Rhino.Geometry;

public class Script_Instance : GH_ScriptInstance
{
    /* 
      Members:
        RhinoDoc RhinoDocument
        GH_Document GrasshopperDocument
        IGH_Component Component
        int Iteration

      Methods (Virtual & overridable):
        Print(string text)
        Print(string format, params object[] args)
        Reflect(object obj)
        Reflect(object obj, string method_name)
    */
  
    private void RunScript(int numEllipses, double baseAxis, out List<Curve> ellipses)
    {
        ellipses = new List<Curve>();

        for(int i = 1; i <= numEllipses; i++)
        {
            // For simplicity, let's assume the proportionality constant = 1
            // Then, T^2 = a^3, so T = a^(3/2)
            double a = baseAxis * i; // semi-major axis length increases with each iteration
            double b = a / 2.0; // semi-minor axis for simplicity, can be modified

            Ellipse ellipse = new Ellipse(Plane.WorldXY, a, b);
            ellipses.Add(ellipse.ToNurbsCurve());
        }
    }
}
# ---------- end mathtype_005_2 ----------
panel_3 = Panel(mathtype_005_2.out)
geometry_3 = Geometry(mathtype_005_2.ellipses)
entwine_2 = Entwine(Branch00=geometry_3, FlattenInputs=True)
panel_4 = Panel(geometry_3)
