# Grasshopper definition 006_Rule of Succession.gh (Grasshopper 1.0.7)
# plug-ins: RhinoCodePluginGH

# WICKERSON STUDIOS
# gpt-4 to C#
# BOILER PLATE
# Grasshopper Files
# gpt-4 Text Prompt
# gpt-4 Initial Response
# Alright, let's turn the formula from the "Rule of
# Succession" into an interesting geometry in
# Grasshopper using C#. To make this more
# visual and interesting, we can represent each
# term of the formula as a shape, where:
# 
# Each random variable
# 
# can be represented as a point. The sum
# 
#   can be seen as the total number of points.
# The probability
# 
# P can be visualized as a circle where the radius
# is proportional to the given probability.
# Use this script editor template to create a script
#  for the C# node in grasshopper for rhino8 that
# models geometry for
# 
# this image
# 
# and specifically to
# 
# turn the formula into an interesting geometry
# 
# //Grasshopper Script Instance
# //#! csharp
# using System;
# using System.Collections;
# using System.Collections.Generic;
# using System.Drawing;
# 
# using Rhino;
# using Rhino.Geometry;
# 
# using Grasshopper;
# using Grasshopper.Kernel;
# using Grasshopper.Kernel.Data;
# using Grasshopper.Kernel.Types;
# 
# public class Script_Instance : GH_ScriptInstance
# {
#   /*
#     Members:
#       RhinoDoc RhinoDocument
#       GH_Document GrasshopperDocument
#       IGH_Component Component
#       int Iteration
# 
#     Methods (Virtual & overridable):
#       Print(string text)
#       Print(string format, params object[] args)
#       Reflect(object obj)
#       Reflect(object obj, string method_name)
#   */
# 
#   private void RunScript(object x, object y, out object a)
#   {
#     // Write your logic here
#     a = null;
#   }
# }
image_sampler = ImageSampler(
    FilePath="C:\Users\Sculpture\Desktop\gpt_4_image_script\MathType_006.JPG",
    Filter="Value",
    Interpolate=True,
    Umax=1,
    Umin=0,
    Vmax=1,
    Vmin=0,
    Wrap=1)
# ADVANCED  SCRIPT
number_slider = Slider(10, range=0..10)
# gpt-4 Transcript link:
# 
# Sharing conversations with images is not yet supported
number_slider_2 = Slider(10, range=0..10)
mathtype_006 = Script(n=number_slider, s=number_slider_2)  # -> out, stems, petals, canopy; inputs n: Int32, s: Int32
# ---------- mathtype_006: C# ----------
// Grasshopper Script Instance
using System;
using System.Collections;
using System.Collections.Generic;
using System.Drawing;

using Rhino;
using Rhino.Geometry;

using Grasshopper;
using Grasshopper.Kernel;
using Grasshopper.Kernel.Data;
using Grasshopper.Kernel.Types;

using System;
using System.Collections.Generic;
using Rhino;
using Rhino.Geometry;

public class Script_Instance : GH_ScriptInstance
{
    private void RunScript(int n, int s, out object stems, out object petals, out object canopy)
    {
        List<Line> stemLines = new List<Line>();
        List<Mesh> petalMeshes = new List<Mesh>();
        Mesh canopyMesh = new Mesh();
        
        double spacing = 4.0; // distance between stems

        for (int i = 0; i < n; i++)
        {
            Point3d basePoint = new Point3d(i * spacing, 0, 0);
            double height = (double) (i + 1) / n * 10; // stem height
            Point3d topPoint = new Point3d(i * spacing, 0, height);
            
            Line stem = new Line(basePoint, topPoint);
            stemLines.Add(stem);

            double probability = (double) (s + 1) / (i + 2);
            
            for (int j = 0; j < s; j++)
            {
                double angle = (2 * Math.PI / s) * j;
                double petalLength = 2 * probability; // use probability to influence petal length
                Vector3d direction = new Vector3d(Math.Cos(angle), Math.Sin(angle), 0);
                Point3d petalEnd = topPoint + direction * petalLength;
                
                Mesh petal = new Mesh();
                petal.Vertices.Add(topPoint);
                petal.Vertices.Add(petalEnd);
                petal.Vertices.Add(petalEnd + Vector3d.ZAxis);
                petal.Faces.AddFace(0, 1, 2);
                petalMeshes.Add(petal);
            }

            canopyMesh.Vertices.Add(topPoint);
        }

        for (int i = 0; i < n - 1; i++)
        {
            canopyMesh.Faces.AddFace(i, i + 1, i + 2);
        }

        stems = stemLines;
        petals = petalMeshes;
        canopy = canopyMesh;
    }
}
# ---------- end mathtype_006 ----------
geometry = Geometry(mathtype_006.stems)
geometry_2 = Geometry(mathtype_006.petals)
geometry_3 = Geometry(mathtype_006.canopy)
entwine = Entwine(Branch00=geometry, Branch01=geometry_2, Branch02=geometry_3, FlattenInputs=True)
panel = Panel(mathtype_006.out)
# BASIC SCRIPT
number_slider_3 = Slider(4, range=0..10)  # disabled
# ADVANCED  SCRIPT
number_slider_4 = Slider(5, range=0..10)  # disabled
panel_2 = Panel(entwine)
number_slider_5 = Slider(6, range=0..10)  # disabled
number_slider_6 = Slider(10, range=0..10)  # disabled
mathtype_006_2 = Script(n=number_slider_3, s=number_slider_4)  # -> out, points, circle; inputs n: Int32, s: Int32; disabled
# ---------- mathtype_006_2: C# ----------
// Grasshopper Script Instance
using System;
using System.Collections;
using System.Collections.Generic;
using System.Drawing;

using Rhino;
using Rhino.Geometry;

using Grasshopper;
using Grasshopper.Kernel;
using Grasshopper.Kernel.Data;
using Grasshopper.Kernel.Types;

using System;
using System.Collections;
using System.Collections.Generic;
using System.Drawing;

using Rhino;
using Rhino.Geometry;

using Grasshopper;
using Grasshopper.Kernel;
using Grasshopper.Kernel.Data;
using Grasshopper.Kernel.Types;

public class Script_Instance : GH_ScriptInstance
{
    /* 
      Members:
        RhinoDoc RhinoDocument
        GH_Document GrasshopperDocument
        IGH_Component Component
        int Iteration

      Methods (Virtual & overridable):
        Print(string text)
        Print(string format, params object[] args)
        Reflect(object obj)
        Reflect(object obj, string method_name)
    */
    
    private void RunScript(int n, int s, out object points, out object circle)
    {
        // Create a list to store our random variable points
        List<Point3d> randomVariables = new List<Point3d>();

        // Generate random variables points
        for (int i = 0; i < n; i++)
        {
            randomVariables.Add(new Point3d(i, 0, 0));
        }

        // Calculate the probability based on Rule of Succession
        double probability = (double) (s + 1) / (n + 2);

        // Represent the probability as a circle with radius proportional to the probability
        Circle probCircle = new Circle(new Point3d(0, 3, 0), probability * 2); // Multiplied by 2 for better visualization

        // Assign output
        points = randomVariables;
        circle = probCircle;
    }
}
# ---------- end mathtype_006_2 ----------
mathtype_006_3 = Script(n=number_slider_5, s=number_slider_6)  # -> out, spiral; inputs n: Int32, s: Int32; disabled
# ---------- mathtype_006_3: C# ----------
// Grasshopper Script Instance
using System;
using System.Collections;
using System.Collections.Generic;
using System.Drawing;

using Rhino;
using Rhino.Geometry;

using Grasshopper;
using Grasshopper.Kernel;
using Grasshopper.Kernel.Data;
using Grasshopper.Kernel.Types;

using System;
using System.Collections.Generic;
using Rhino;
using Rhino.Geometry;

using Grasshopper;
using Grasshopper.Kernel;
using Grasshopper.Kernel.Data;
using Grasshopper.Kernel.Types;

public class Script_Instance : GH_ScriptInstance
{
    /* 
      Members:
        RhinoDoc RhinoDocument
        GH_Document GrasshopperDocument
        IGH_Component Component
        int Iteration

      Methods (Virtual & overridable):
        Print(string text)
        Print(string format, params object[] args)
        Reflect(object obj)
        Reflect(object obj, string method_name)
    */
    
    private void RunScript(int n, int s, out object spiral)
    {
        List<Point3d> points = new List<Point3d>();

        double maxHeight = n * 2; // Height of the tower
        double totalTurns = 2 * Math.PI * s; // Total rotation for successes

        for (int i = 1; i <= n; i++)
        {
            double t = (double) i / n;
            double currentHeight = t * maxHeight;
            double theta = t * totalTurns;

            double probability = (double) (s + 1) / (i + 2);
            double radius = probability * 5; // Multiplied for better visualization

            double x = radius * Math.Cos(theta);
            double y = radius * Math.Sin(theta);

            points.Add(new Point3d(x, y, currentHeight));
        }

        Polyline pline = new Polyline(points);
        spiral = pline.ToNurbsCurve();
    }
}
# ---------- end mathtype_006_3 ----------
geometry_4 = Geometry(mathtype_006_2.circle)  # disabled
geometry_5 = Geometry(mathtype_006_2.points)  # disabled
panel_3 = Panel(mathtype_006_2.out)  # disabled
geometry_6 = Geometry(mathtype_006_3.spiral)  # disabled
entwine_2 = Entwine(Branch00=geometry_5, Branch01=geometry_4, FlattenInputs=True)  # disabled
panel_4 = Panel(mathtype_006_3.out)  # disabled
entwine_3 = Entwine(Branch00=geometry_6, FlattenInputs=True)  # disabled
panel_5 = Panel(entwine_2)  # disabled
panel_6 = Panel(geometry_6)  # disabled
