# Grasshopper definition 007_Hyperbolic_Functions.gh (Grasshopper 1.0.7)
# plug-ins: RhinoCodePluginGH

# WICKERSON STUDIOS
# gpt-4 to C#
# BOILER PLATE
# Grasshopper Files
# gpt-4 Text Prompt
# gpt-4 Initial Response
image_sampler = ImageSampler(
    FilePath="C:\Users\Sculpture\Desktop\gpt_4_image_script\MathType_007.JPG",
    Filter="Value",
    Interpolate=True,
    Umax=1,
    Umin=0,
    Vmax=1,
    Vmin=0,
    Wrap=1)
# To model the hyperbolic functions presented in
# the image using Grasshopper's C# script node,
# we'll define the formulas for sinh, cosh, and tanh
#  within the provided script template and create a
#  list of points that represent the values of these
#  functions across a specified domain. Here's a
#  script that accomplishes this:
# Use this script editor template to create a script
#  for the C# node in grasshopper for rhino8 that
# models geometry for
# 
# this image
# 
# and specifically to
# 
# turn the formula into an interesting geometry
# 
# //Grasshopper Script Instance
# //#! csharp
# using System;
# using System.Collections;
# using System.Collections.Generic;
# using System.Drawing;
# 
# using Rhino;
# using Rhino.Geometry;
# 
# using Grasshopper;
# using Grasshopper.Kernel;
# using Grasshopper.Kernel.Data;
# using Grasshopper.Kernel.Types;
# 
# public class Script_Instance : GH_ScriptInstance
# {
#   /*
#     Members:
#       RhinoDoc RhinoDocument
#       GH_Document GrasshopperDocument
#       IGH_Component Component
#       int Iteration
# 
#     Methods (Virtual & overridable):
#       Print(string text)
#       Print(string format, params object[] args)
#       Reflect(object obj)
#       Reflect(object obj, string method_name)
#   */
# 
#   private void RunScript(object x, object y, out object a)
#   {
#     // Write your logic here
#     a = null;
#   }
# }
# BASIC SCRIPT
number_slider = Slider(-3, range=-3..3)
# ADVANCED  SCRIPT
# gpt-4 Transcript link:
# 
# Sharing conversations with images is not yet supported
number_slider_2 = Slider(0.1, range=0.1..1)
mathtype_008 = Script(domainStart=number_slider, domainEnd=Slider(3, range=-3..3), interval=number_slider_2)  # -> out, sinhPts, coshPts, tanhPts; inputs domainStart: Double, domainEnd: Double, interval: Double
# ---------- mathtype_008: C# ----------
// Grasshopper Script Instance
using System;
using System.Collections;
using System.Collections.Generic;
using System.Drawing;

using Rhino;
using Rhino.Geometry;

using Grasshopper;
using Grasshopper.Kernel;
using Grasshopper.Kernel.Data;
using Grasshopper.Kernel.Types;

public class Script_Instance : GH_ScriptInstance
{
  private void RunScript(double domainStart, double domainEnd, double interval, out object sinhPts, out object coshPts, out object tanhPts)
  {
    List<Point3d> sinhPoints = new List<Point3d>();
    List<Point3d> coshPoints = new List<Point3d>();
    List<Point3d> tanhPoints = new List<Point3d>();

    for (double i = domainStart; i <= domainEnd; i += interval)
    {
      double sinhValue = (Math.Exp(i) - Math.Exp(-i)) / 2;
      double coshValue = (Math.Exp(i) + Math.Exp(-i)) / 2;
      double tanhValue = sinhValue / coshValue;

      sinhPoints.Add(new Point3d(i, sinhValue, 0));
      coshPoints.Add(new Point3d(i, coshValue, 0));
      tanhPoints.Add(new Point3d(i, tanhValue, 0));
    }

    sinhPts = sinhPoints;
    coshPts = coshPoints;
    tanhPts = tanhPoints;
  }
}
# ---------- end mathtype_008 ----------
geometry = Geometry(mathtype_008.coshPts)
geometry_2 = Geometry(mathtype_008.tanhPts)
geometry_3 = Geometry(mathtype_008.sinhPts)
panel = Panel(mathtype_008.out)
entwine = Entwine(Branch00=geometry_3, Branch01=geometry, Branch02=geometry_2, FlattenInputs=True)
panel_2 = Panel(entwine)
